# Grasshopper definition chairPipes.gh (Grasshopper 1.0.7)
# plug-ins: Kangaroo2 Components, Weaverbird

box = CenterBox(Base=PlaneXY(0, 0, 0), X=Slider(50, range=0..100), Y=Slider(18.92, range=0..100), Z=Slider(18.92, range=0..100))
pop3d = Populate3D(Region=box, Count=Slider(15, range=0..1000), Seed=Slider(0, range=0..100))
voronoi³ = Voronoi3D(Points=pop3d, Box=box)  # -> Cells, Boundary
volume = Volume(Geometry=voronoi³.Cells)  # -> Volume, graft(Centroid)
debrep = DeconstructBrep(Brep=voronoi³.Cells)  # -> Faces, Edges, Vertices
area = Area(Geometry=debrep.Faces)  # -> simplify(Area), Centroid

box_2 = CenterBox(Base=PlaneXY(0, 0, 0), X=Slider(12, range=0..100), Y=Slider(18.92, range=0..100), Z=Slider(18.92, range=0..100))
X = UnitX(Factor=Slider(62, range=0..100, expression="-x"))
move = Move(Geometry=box_2, Motion=X)  # -> Geometry, Transform

box_3 = CenterBox(Base=PlaneXY(0, 0, 0), X=Slider(12, range=0..100), Y=Slider(18.92, range=0..100), Z=Slider(18.92, range=0..100))
X_2 = UnitX(Factor=Slider(62, range=0..100))
move_2 = Move(Geometry=box_3, Motion=X_2)  # -> Geometry, Transform

debrep_2 = DeconstructBrep(Brep=box)  # -> Faces, Edges, Vertices

smesh = SimpleMesh(Brep=voronoi³.Cells)
wbframe = WeaverbirdsPictureFrame(MeshPolylines=smesh, Distance=5, InsetType=0)
wbloop = WeaverbirdsLoopSubdivision(MeshCurves=wbframe, Level=Slider(3, range=0..10), SmoothNakedEdges=1)
wbthicken = WeaverbirdsMeshThicken(MeshCurves=wbloop, Distance=Slider(1, range=0..1), OffsetType=0)

ln = Line(StartPoint=volume.Centroid, EndPoint=area.Centroid)  # -> flatten(Line)
mp = MultiPipe(
    Curves=ln,
    NodeSize=Slider(2, range=0..10),
    EndOffset=Slider(0, range=0..1),
    StrutSize=Slider(1, range=0..10),
    Segment=0,
    KinkAngle=0.6,
    CubeFit=0,
    Caps=Slider(1, range=0..1))

mp_2 = MultiPipe(
    Curves=debrep_2.Edges,
    NodeSize=Slider(2, range=0..10),
    EndOffset=1,
    StrutSize=1,
    Segment=0,
    KinkAngle=0.6,
    CubeFit=0,
    Caps=0)
meshsubd = MeshFromSubD(SubD=mp_2, Density=2)
meshsubd_2 = MeshFromSubD(SubD=mp, Density=2)
fuse = SubDFuse(SubDA=meshsubd_2, SubDB=meshsubd, BooleanOption=0, Smoothing=10)
