# Grasshopper definition chairGH.gh (Grasshopper 1.0.7)

geo = Geometry(<brep referenced from the Rhino model>)
box = Box(geo)
edges = BrepEdges(Brep=box)  # -> Naked, Interior, NonManifold
item = ListItem(List=edges.Interior, Index=Slider(0, range=0..10), Wrap=True)
curvepoint = PointOnCurve(item, parameter=0)
vec = Vector(item)
contour = Contour(Shape=geo, Point=curvepoint, Direction=vec, Distance=Slider(1.5, range=0..10))
multiplication = Multiplication(A=vec, B=Slider(5.8, range=0..10))
boundary = BoundarySurfaces(Edges=contour)
extr = Extrude(Base=boundary, Direction=multiplication)
sunion = SolidUnion(Breps=extr)
