# Grasshopper definition task1.gh (Grasshopper 1.0.7)

number_slider = Slider(6, range=0..100)
range = Range(Domain=Domain(0, 1), Steps=expr("x-1", number_slider))
series = Series(Start=0, Step=Slider(11, range=0..100), Count=number_slider)
graph = GraphMapper(
    range,
    x0=0,
    x1=1,
    y0=0,
    y1=1,
    container_name="Bezier2",
    pt=[Point(0, 0.2084403634, 0), Point(0, 1, 0), Point(0.5620913506, 0.8108838797, 0), Point(0.5025245547, 0.5835624337, 0), Point(0.4193910438, 0.2663046454, 0), Point(1, 0.7894923687, 0), Point(1, 0.9989128709, 0)])
graph_2 = GraphMapper(
    range,
    x0=0,
    x1=1,
    y0=0,
    y1=1,
    container_name="Bezier2",
    pt=[Point(0, 0, 0), Point(0.7155438662, 0, 0), Point(0.5184420512, 0.2279687858, 0), Point(0.5, 0.5, 0), Point(0.4825231433, 0.7577940226, 0), Point(0.1415170878, 1, 0), Point(1, 1, 0)])
pt = ConstructPoint(XCoordinate=0, YCoordinate=0, ZCoordinate=series)
multiplication = Multiplication(A=Slider(50, range=0..100), B=graph)
multiplication_2 = Multiplication(A=Slider(24, range=0..100), B=graph_2)
xy = XYPlane(Origin=pt)
prot = RotatePlane(Plane=xy, Angle=degrees(multiplication_2))
cir = Circle(Plane=prot, Radius=multiplication)
crv = Curve(graft(cir))
divide = DivideCurve(Curve=crv, Count=Slider(44, range=0..100), Kinks=False)  # -> Points, Tangents, Parameters
area = Area(Geometry=crv)  # -> Area, Centroid
dispatch = Dispatch(List=divide.Points, DispatchPattern=[True, False])  # -> ListA, ListB
scale = Scale(Geometry=dispatch.ListB, Center=area.Centroid, Factor=Slider(0.93, range=0..1))  # -> Geometry, Transform
weave = Weave(Pattern=[0, 1], Stream0=dispatch.ListA, Stream1=scale.Geometry, NullGaps=False)
pline = PolyLine(Vertices=weave, Closed=True)  # -> flatten(Polyline)
loft = Loft(Curves=pline, Options={Adjust=False, Closed=False, LoftEnds=0, LoftSimp=0, LoftType=0, Rebuild=10, Refit=0.01})
