# Grasshopper definition task2.gh (Grasshopper 1.0.7)

number_slider = Slider(15, range=0..100)
brep = Brep(<brep referenced from the Rhino model>)
crv = Curve(<curve referenced from the Rhino model>)
pframes = PerpFrames(Curve=crv, Count=number_slider, Align=True)  # -> Frames, Parameters
sec = BrepPlane(Brep=brep, Plane=pframes.Frames)  # -> Curves, Points
fillet = Fillet(Curve=sec.Curves, Radius=Slider(2.09, range=0..10))
boundary = BoundarySurfaces(Edges=flatten(fillet))
X = UnitX(Factor=Slider(0.6, range=0..10))
move = Move(Geometry=boundary, Motion=expr("x/2", X))  # -> Geometry, Transform
extr = Extrude(Base=move.Geometry, Direction=expr("-x", X))
orient = Orient(Geometry=boundary, Source=pframes.Frames, Target=PlaneXY(0, 0, 0))  # -> Geometry, Transform
box = Box(orient.Geometry)
debrep = DeconstructBrep(Brep=box)  # -> Faces, Edges, Vertices
item = ListItem(List=debrep.Edges, Index=0, Wrap=True)
num = Number(item)
ma = MassAddition(Input=flatten(num))  # -> Result, PartialResults
multiplication = Multiplication(A=ma.PartialResults, B=Slider(1.2, range=0..10))
X_2 = UnitX(Factor=multiplication)
move_2 = Move(Geometry=orient.Geometry, Motion=X_2)  # -> Geometry, Transform
wires = BrepWireframe(Brep=move_2.Geometry, Density=-1)
join = JoinCurves(Curves=wires, Preserve=False)
box_2 = Box(join)
box_3 = EvaluateBox(Box=box_2, UParameter=0.5, VParameter=0.5, WParameter=0.5)  # -> flatten(Plane), Point, Include
series = Series(Start=0, Step=1, Count=expr("x+1", number_slider))
tag = TextTag3D(Location=box_3.Plane, Text=series, Size=1, Justification=7)
